# Grasshopper definition Ettv_BcaValidationCaseStudy.gh (Grasshopper 1.0.8)
# plug-ins: FacadeFlux Info

fluxmaterialdatabase = FluxMaterialDatabase(SelectedMaterial="Air gap")  # -> MaterialName, KValue
fluxmaterialdatabase_2 = FluxMaterialDatabase(SelectedMaterial="Glass, sheet")  # -> MaterialName, KValue
fluxmaterialdatabase_3 = FluxMaterialDatabase(SelectedMaterial="Concrete")  # -> MaterialName, KValue
fluxmaterial = FluxMaterial(Name=fluxmaterialdatabase.MaterialName, Conductivity=fluxmaterialdatabase.KValue, Thickness="100")
fluxmaterial_2 = FluxMaterial(Name=fluxmaterialdatabase_3.MaterialName, Conductivity=fluxmaterialdatabase_3.KValue, Thickness="250")
fluxmaterial_3 = FluxMaterial(Name=fluxmaterialdatabase_2.MaterialName, Conductivity=fluxmaterialdatabase_2.KValue, Thickness="8")
merge = Merge(Data1=fluxmaterial_3, Data2=fluxmaterial, Data3=fluxmaterial_2)
fluxopaqueconstruction = FluxOpaqueConstruction(Id="W3", Name="250mm r.c beam with glass cladding", Materials=merge)

fluxmaterialdatabase_4 = FluxMaterialDatabase(SelectedMaterial="Air gap")  # -> MaterialName, KValue
fluxmaterialdatabase_5 = FluxMaterialDatabase(SelectedMaterial="Glass, sheet")  # -> MaterialName, KValue
fluxmaterialdatabase_6 = FluxMaterialDatabase(SelectedMaterial="Plaster: sand/cement")  # -> MaterialName, KValue
fluxmaterialdatabase_7 = FluxMaterialDatabase(SelectedMaterial="Plaster: sand/cement")  # -> MaterialName, KValue
fluxmaterialdatabase_8 = FluxMaterialDatabase(SelectedMaterial="Brick (dry, covered by plaster/tiles)")  # -> MaterialName, KValue
fluxmaterial_4 = FluxMaterial(Name=fluxmaterialdatabase_4.MaterialName, Conductivity=fluxmaterialdatabase_4.KValue, Thickness="100")
fluxmaterial_5 = FluxMaterial(Name=fluxmaterialdatabase_6.MaterialName, Conductivity=fluxmaterialdatabase_6.KValue, Thickness="12")
fluxmaterial_6 = FluxMaterial(Name=fluxmaterialdatabase_5.MaterialName, Conductivity=fluxmaterialdatabase_5.KValue, Thickness="8")
fluxmaterial_7 = FluxMaterial(Name=fluxmaterialdatabase_7.MaterialName, Conductivity=fluxmaterialdatabase_7.KValue, Thickness="12")
fluxmaterial_8 = FluxMaterial(Name=fluxmaterialdatabase_8.MaterialName, Conductivity=fluxmaterialdatabase_8.KValue, Thickness="115")
merge_2 = Merge(Data1=fluxmaterial_6, Data2=fluxmaterial_4, Data3=fluxmaterial_5, Data4=fluxmaterial_8, Data5=fluxmaterial_7)
fluxopaqueconstruction_2 = FluxOpaqueConstruction(Id="W4", Name="115mm brick parapet with glass cladding", Materials=merge_2)

fluxmaterialdatabase_9 = FluxMaterialDatabase(SelectedMaterial="Glass, sheet")  # -> MaterialName, KValue
fluxmaterialdatabase_10 = FluxMaterialDatabase(SelectedMaterial="Air gap")  # -> MaterialName, KValue
fluxmaterialdatabase_11 = FluxMaterialDatabase(SelectedMaterial="Glass, sheet")  # -> MaterialName, KValue
fluxmaterial_9 = FluxMaterial(Name=fluxmaterialdatabase_10.MaterialName, Conductivity=fluxmaterialdatabase_10.KValue, Thickness="100")
fluxmaterial_10 = FluxMaterial(Name=fluxmaterialdatabase_9.MaterialName, Conductivity=fluxmaterialdatabase_9.KValue, Thickness="6")
fluxmaterial_11 = FluxMaterial(Name=fluxmaterialdatabase_11.MaterialName, Conductivity=fluxmaterialdatabase_11.KValue, Thickness="8")
merge_3 = Merge(Data1=fluxmaterial_11, Data2=fluxmaterial_9, Data3=fluxmaterial_10)
fluxfenestrationconstruction = FluxFenestrationConstruction(Id="F2", Name="Double Glazing", Materials=merge_3, Sc="0.47")

fluxmaterial_12 = FluxMaterial(Name="RC Concrete", Conductivity="1.442", Thickness="250")
fluxmaterial_13 = FluxMaterial(Name="Cement Plaster", Conductivity="0.533", Thickness="12")
fluxmaterial_14 = FluxMaterial(Name="Marble Tile", Conductivity="1.298", Thickness="12")
merge_4 = Merge(Data1=fluxmaterial_14, Data2=fluxmaterial_12, Data3=fluxmaterial_13)
fluxopaqueconstruction_3 = FluxOpaqueConstruction(Id="W1", Name="250mm R.C Beam", Materials=merge_4)

fluxmaterial_15 = FluxMaterial(Name="RC Concrete", Conductivity="1.442", Thickness="200")
fluxmaterial_16 = FluxMaterial(Name="Cement Plaster", Conductivity="0.533", Thickness="12")
fluxmaterial_17 = FluxMaterial(Name="Marble Tile", Conductivity="1.298", Thickness="12")
merge_5 = Merge(Data1=fluxmaterial_17, Data2=fluxmaterial_15, Data3=fluxmaterial_16)
fluxopaqueconstruction_4 = FluxOpaqueConstruction(Id="W2", Name="200mm r.c beam", Materials=merge_5)

# ----
# Create Envelope Construction Material-by-Material
# Envelope Construction Database
fluxmaterialdatabase_12 = FluxMaterialDatabase(SelectedMaterial="Glass, sheet")  # -> MaterialName, KValue
fluxmaterial_18 = FluxMaterial(Name=fluxmaterialdatabase_12.MaterialName, Conductivity=fluxmaterialdatabase_12.KValue, Thickness="8")
fluxfenestrationconstruction_2 = FluxFenestrationConstruction(Id="F1", Name="8mm Single Glazing", Materials=fluxmaterial_18, Sc="0.61")

data = Data(fluxopaqueconstruction_3)
data_2 = Data(fluxfenestrationconstruction_2)
data_3 = Data(fluxopaqueconstruction_4)
data_4 = Data(fluxopaqueconstruction)
data_5 = Data(fluxfenestrationconstruction)
data_6 = Data(fluxopaqueconstruction_2)

# ----
# Combine Material Data with Geometry
# Surface + Construction Data
brep = Brep(<brep referenced from the Rhino model>)
brep_2 = Brep(<brep referenced from the Rhino model>)
brep_3 = Brep([<brep referenced from the Rhino model> x2])
brep_4 = Brep([<brep referenced from the Rhino model> x23])
brep_5 = Brep([<brep referenced from the Rhino model> x23])
brep_6 = Brep([<brep referenced from the Rhino model> x23])
deconstruct_brep = DeconstructBrep(Brep=brep)  # -> flatten(Faces), Edges, Vertices
deconstruct_brep_2 = DeconstructBrep(Brep=brep_2)  # -> flatten(Faces), Edges, Vertices
deconstruct_brep_3 = DeconstructBrep(Brep=brep_3)  # -> flatten(Faces), Edges, Vertices
deconstruct_brep_4 = DeconstructBrep(Brep=brep_4)  # -> flatten(Faces), Edges, Vertices
deconstruct_brep_5 = DeconstructBrep(Brep=brep_5)  # -> flatten(Faces), Edges, Vertices
deconstruct_brep_6 = DeconstructBrep(Brep=brep_6)  # -> flatten(Faces), Edges, Vertices
fluxsurface = FluxSurface(Geometry=deconstruct_brep_6.Faces, FluxConstruction=data_6)
fluxsurface_2 = FluxSurface(Geometry=deconstruct_brep_4.Faces, FluxConstruction=data_5)
fluxsurface_3 = FluxSurface(Geometry=deconstruct_brep_2.Faces, FluxConstruction=data)
fluxsurface_4 = FluxSurface(Geometry=deconstruct_brep_3.Faces, FluxConstruction=data_3)
fluxsurface_5 = FluxSurface(Geometry=deconstruct_brep_5.Faces, FluxConstruction=data_4)
fluxsurface_6 = FluxSurface(Geometry=deconstruct_brep.Faces, FluxConstruction=data_2)
fluxexternalshading = FluxExternalShading(FluxSurface=fluxsurface_6, R1="1")

# ----
# Model Assembly + Process + Export Html
merge_6 = Merge(
    Data1=fluxexternalshading,
    Data2=fluxsurface_3,
    Data3=fluxsurface_4,
    Data4=fluxsurface,
    Data5=fluxsurface_2,
    Data6=fluxsurface_5)
# Merge, Create Model, and Calculate!
panel = Panel("BCA_CaseStudy1")
fluxmodel = FluxModel(ProjectName=panel, FluxSurfaces=merge_6, AngleToNorth="0")  # -> Status, FluxModel
boolean_toggle = BooleanToggle(True)
computefluxmodel = ComputeFluxModel(FluxModel=fluxmodel.FluxModel, RunComputation=boolean_toggle, ComputationType="0")  # -> Summary, ThermalTransferValue, FluxModelResult
# Generate Report
button = Button()

exportfluxhtml = ExportFluxHtml(Result=computefluxmodel.FluxModelResult, RunExport=boolean_toggle)  # -> HtmlPath, HtmlDocument, FileDirectory

fluxopenreport = FluxOpenReport(HtmlPath=exportfluxhtml.HtmlPath, ViewReport=button)

# ----
# 3D Display
fluxmodelsurfaceheatgain = FluxModelSurfaceHeatGain(FluxModelResult=computefluxmodel.FluxModelResult)  # -> Meshes, FluxLegend
display_fluxconstruction_type = DisplayFluxConstructionType(FluxModel=computefluxmodel.FluxModelResult)  # -> Meshes, FluxLegend
display_fluxconstruction_names = DisplayFluxConstructionNames(FluxModel=computefluxmodel.FluxModelResult)  # -> Meshes, FluxLegend

# ----
# Result Plot
display_fluxconstruction_u_value = DisplayFluxConstructionUValue(FluxModel=computefluxmodel.FluxModelResult)  # -> Meshes, FluxLegend
fluxlegend = FluxLegend(FluxLegend=fluxmodelsurfaceheatgain.FluxLegend)
fluxlegend_2 = FluxLegend(FluxLegend=display_fluxconstruction_names.FluxLegend)
fluxlegend_3 = FluxLegend(FluxLegend=display_fluxconstruction_u_value.FluxLegend)
fluxlegend_4 = FluxLegend(FluxLegend=display_fluxconstruction_type.FluxLegend)
