# Grasshopper definition SchoolBuilding.gh (Grasshopper 1.0.8)
# plug-ins: BcaEttv Info

rectangle = Rectangle(Plane=PlaneXY(0, 0, 0), XSize=Domain(-1, 1), YSize=Domain(-2, 2), Radius=0)  # -> Rectangle, Length
panel = Panel("""0
1
2""")
explode = Explode(Curve=rectangle.Rectangle, Recursive=True)  # -> Segments, Vertices
number_slider = Slider(0.95, range=0..5)
list_item = ListItem(List=explode.Segments, Index=panel, Wrap=True)
negative = Negative(Value=number_slider)
join_curves = JoinCurves(Curves=list_item, Preserve=False)
curve = Curve(rectangle.Rectangle)
offset_curve = OffsetCurve(Curve=join_curves, Distance=[number_slider, negative], Corners=1)
evaluate_curve = EvaluateCurve(Curve=reparameterize(offset_curve), Parameter="1")  # -> Point, Tangent, Angle
evaluate_curve_2 = EvaluateCurve(Curve=reparameterize(offset_curve), Parameter="0")  # -> Point, Tangent, Angle
explode_tree = ExplodeTree(Data=evaluate_curve.Point)  # -> _0000, _0001
explode_tree_2 = ExplodeTree(Data=evaluate_curve_2.Point)  # -> _0000, _0001
line = Line(StartPoint=explode_tree._0000, EndPoint=explode_tree._0001)
line_2 = Line(StartPoint=explode_tree_2._0000, EndPoint=explode_tree_2._0001)
merge = Merge(Data1=flatten(offset_curve), Data2=flatten(line_2), Data3=flatten(line))
join_curves_2 = JoinCurves(Curves=merge, Preserve=False)
scale = Scale(Geometry=join_curves_2, Center=Point(0, 0, 0), Factor=Slider(10, range=0..10))  # -> Geometry, Transform
unit_z = UnitZ(Factor=Slider(5, range=0..10))
extrude = Extrude(Base=scale.Geometry, Direction=unit_z)
linear_array = LinearArray(Geometry=extrude, Direction=unit_z, Count=Slider(4, range=0..10))  # -> Geometry, Transform
deconstruct_brep = DeconstructBrep(Brep=linear_array.Geometry)  # -> Faces, Edges, Vertices
negative_2 = Negative(Value=Slider(2, range=0..2))
face_boundaries = FaceBoundaries(Mesh=deconstruct_brep.Faces)  # -> flatten(Boundaries)
offset_curve_2 = OffsetCurve(Curve=face_boundaries, Distance=negative_2, Corners=1)
boundary_surfaces = BoundarySurfaces(Edges=offset_curve_2)  # -> flatten(Surfaces)
solid_difference = SolidDifference(BrepsA=flatten(deconstruct_brep.Faces), BrepsB=flatten(boundary_surfaces))
area = Area(Geometry=[solid_difference, boundary_surfaces])  # -> Area, Centroid
mass_addition = MassAddition(Input=area.Area)  # -> Result, PartialResults

number_slider_2 = Slider(5, range=0..10)
unit_z_2 = UnitZ(Factor=number_slider_2)
rectangle_2 = Rectangle(Plane=PlaneXY(0, 0, 0), XSize=number_slider_2, YSize=number_slider_2, Radius=0)  # -> Rectangle, Length
extrude_2 = Extrude(Base=rectangle_2.Rectangle, Direction=unit_z_2)
deconstruct_brep_2 = DeconstructBrep(Brep=extrude_2)  # -> Faces, Edges, Vertices
area_2 = Area(Geometry=deconstruct_brep_2.Faces)  # -> Area, Centroid
scale_2 = Scale(Geometry=deconstruct_brep_2.Faces, Center=area_2.Centroid, Factor=Slider(0.5, range=0..1))  # -> Geometry, Transform
solid_difference_2 = SolidDifference(BrepsA=flatten(deconstruct_brep_2.Faces), BrepsB=flatten(scale_2.Geometry))
brep_wireframe = BrepWireframe(Brep=[scale_2.Geometry, solid_difference_2], Density=-1)

ettvmaterialdatabase = EttvMaterialDatabase(SelectedMaterial="Oxygen gas")  # -> MaterialName, KValue
ettvmaterialdatabase_2 = EttvMaterialDatabase(SelectedMaterial="Glass, sheet")  # -> MaterialName, KValue
ettvmaterial = EttvMaterial(Name=ettvmaterialdatabase.MaterialName, Conductivity=ettvmaterialdatabase.KValue, Thickness="13")
ettvmaterial_2 = EttvMaterial(Name=ettvmaterialdatabase_2.MaterialName, Conductivity=ettvmaterialdatabase_2.KValue, Thickness="6")
merge_2 = Merge(Data1=ettvmaterial_2, Data2=ettvmaterial, Data3=ettvmaterial_2)
ettvfenestrationconstruction = EttvFenestrationConstruction(Id="F1", Name="Double Glazing", Materials=merge_2, Sc="0.43")

ettvmaterialdatabase_3 = EttvMaterialDatabase(SelectedMaterial="Glass wool, mat or quilt (dry)")  # -> MaterialName, KValue
ettvmaterialdatabase_4 = EttvMaterialDatabase(SelectedMaterial="Aluminium alloy, typical")  # -> MaterialName, KValue
ettvmaterialdatabase_5 = EttvMaterialDatabase(SelectedMaterial="Oxygen gas")  # -> MaterialName, KValue
ettvmaterialdatabase_6 = EttvMaterialDatabase(SelectedMaterial="Concrete, lightweight (density 1280 kg/m³)")  # -> MaterialName, KValue
ettvmaterial_3 = EttvMaterial(Name=ettvmaterialdatabase_3.MaterialName, Conductivity=ettvmaterialdatabase_3.KValue, Thickness="120")
ettvmaterial_4 = EttvMaterial(Name=ettvmaterialdatabase_5.MaterialName, Conductivity=ettvmaterialdatabase_5.KValue, Thickness="75")
ettvmaterial_5 = EttvMaterial(Name=ettvmaterialdatabase_4.MaterialName, Conductivity=ettvmaterialdatabase_4.KValue, Thickness="1.5")
ettvmaterial_6 = EttvMaterial(Name=ettvmaterialdatabase_6.MaterialName, Conductivity=ettvmaterialdatabase_6.KValue, Thickness="110")
merge_3 = Merge(Data1=ettvmaterial_5, Data2=ettvmaterial_3, Data3=ettvmaterial_5, Data4=ettvmaterial_4, Data5=ettvmaterial_6)
ettvopaqueconstruction = EttvOpaqueConstruction(Id="W1", Name="ACP + Lightweight Concrete", Materials=merge_3)

deconstruct_ettvmaterial = DeconstructEttvMaterial(EttvMaterial=merge_3)  # -> Summary, Name, Thickness, ThermalConductivity
deconstructettvconstruction = DeconstructEttvConstruction(EttvConstruction=ettvfenestrationconstruction)  # -> Text, Uvalue, ScValue, Materials
deconstructettvconstruction_2 = DeconstructEttvConstruction(EttvConstruction=ettvopaqueconstruction)  # -> Text, Uvalue, ScValue, Materials
panel_2 = Panel(deconstructettvconstruction_2.Text)
area_3 = Area(Geometry=scale_2.Geometry)  # -> Area, Centroid
panel_3 = Panel(deconstructettvconstruction.Text)
brep_wireframe_2 = BrepWireframe(Brep=[solid_difference, boundary_surfaces], Density=-1)
deconstruct_ettvmaterial_2 = DeconstructEttvMaterial(EttvMaterial=deconstructettvconstruction_2.Materials)  # -> Summary, Name, Thickness, ThermalConductivity
ettvsurfacecomponent = EttvSurfaceComponent(Geometry=boundary_surfaces, EttvConstruction=ettvfenestrationconstruction)  # -> flatten(EttvSurfaces)
panel_4 = Panel(deconstruct_ettvmaterial_2.Summary)
sc2generator = Sc2Generator(EttvSurface=ettvsurfacecomponent, ShadingProjection=Slider(0, range=0..1), GlazingHeight=Slider(1, range=0..1))  # -> flatten(EttvSurface)
deconstruct_ettvsurface = DeconstructEttvSurface(EttvSurfaces=sc2generator)  # -> Text, Geometries, Areas, Orientations, EttvConstructions
ettvsurfacecomponent_2 = EttvSurfaceComponent(Geometry=solid_difference, EttvConstruction=ettvopaqueconstruction)  # -> flatten(EttvSurfaces)
deconstruct_ettvconstruction = DeconstructEttvConstruction(EttvConstruction=deconstruct_ettvsurface.EttvConstructions)  # -> Summary, Uvalue, ScValue, Materials
deconstruct_ettvsurface_2 = DeconstructEttvSurface(EttvSurfaces=ettvsurfacecomponent_2)  # -> Text, Geometries, Areas, Orientations, EttvConstructions
merge_4 = Merge(Data1=ettvsurfacecomponent_2, Data2=flatten(ettvsurfacecomponent))
panel_5 = Panel(deconstruct_ettvconstruction.ScValue)
deconstruct_ettvconstruction_2 = DeconstructEttvConstruction(EttvConstruction=deconstruct_ettvsurface_2.EttvConstructions)  # -> Summary, Uvalue, ScValue, Materials
ettvmodel = EttvModel(ProjectName="SchoolBuilding", Version="0", EttvSurfaces=merge_4, AngleToNorth="45")  # -> Status, EttvModel
boolean_toggle = BooleanToggle(True)
panel_6 = Panel(deconstruct_ettvconstruction_2.Summary)
deconstruct_ettvmodel = DeconstructEttvModel(EttvModel=ettvmodel.EttvModel)  # -> Text, ProjectName, Version, EttvSurfaces
computeretv = ComputeRetv(EttvModel=ettvmodel.EttvModel, RunComputation=boolean_toggle)  # -> Summary, RetvValue, RetvResult
computeettv = ComputeEttv(EttvModel=ettvmodel.EttvModel, RunComputation=boolean_toggle)  # -> Summary, EttvValue, EttvResult, HtmlReport
display_ettv_construction_type = DisplayEttvConstructionType(EttvModel=ettvmodel.EttvModel)  # -> Meshes, Legend
deconstruct_ettvsurface_3 = DeconstructEttvSurface(EttvSurfaces=deconstruct_ettvmodel.EttvSurfaces)  # -> Text, Geometries, Areas, Orientations, EttvConstructions
panel_7 = Panel(computeettv.Summary)
read_ettv_surface_result = ReadEttvSurfaceResult()  # -> Surfaces, HeatGain
panel_8 = Panel(display_ettv_construction_type.Legend)
deconstruct_ettvconstruction_3 = DeconstructEttvConstruction(EttvConstruction=deconstruct_ettvsurface_3.EttvConstructions)  # -> Summary, Uvalue, ScValue, Materials
bounds = Bounds(Numbers=read_ettv_surface_result.HeatGain)
deconstruct_domain = DeconstructDomain(Domain=bounds)  # -> Start, End
create_set = CreateSet(List=deconstruct_ettvconstruction_3.Summary)  # -> Set, Map
panel_9 = Panel(create_set.Set)
gradient = Gradient(
    LowerLimit=deconstruct_domain.End,
    UpperLimit=deconstruct_domain.Start,
    Parameter=read_ettv_surface_result.HeatGain,
    stops=[0: RGB(234, 38, 0), 0.25: RGB(234, 126, 0), 0.5: RGB(254, 244, 84), 0.75: RGB(173, 203, 249), 1: RGB(75, 107, 169)])
custom_preview = CustomPreview(Geometry=read_ettv_surface_result.Surfaces, Material=gradient)
